# Grasshopper definition ChatGPT_Python_002.gh (Grasshopper 1.0.7)
# plug-ins: ScriptParasite, Fologram For Grasshopper Utilities, Bifocals, Hops, Kangaroo2 Components

# ----
# Bake Engine
trigger = Trigger(Interval=1000, TimerInterval=1000, Target=data_recorder)  # disabled
data_recorder = DataRecorder("1", DataLimit=-10, RecordData=False)
list_length = ListLength(List=data_recorder)
testnumbereven = TestNumberEven(num=list_length)  # -> out, IsEven; inputs num: Int32
# ---------- testnumbereven: C# ----------
    int mod = num % 2;
    IsEven = (mod == 0 ? true : false);
# ---------- end testnumbereven ----------
panel = Panel(list_length)
panel_2 = Panel(testnumbereven.IsEven)

panel_3 = Panel("""#Write the python 3.0 script for the following psuedo code for the hops node in grasshopper for Rhino3d
#use flask and the ghhops_server in python 3.0 and the @hops.component
#create a machine learning algorithm for linear regression
#inputs are test data, inputs, outputs, seed and outputs are results""")
number_slider = Slider(-11, range=-100..100)
number_slider_2 = Slider(8, range=0..10)
number_slider_3 = Slider(10, range=0..10)
series = Series(Start=number_slider, Step=number_slider_2, Count=number_slider_3)
series_2 = Series(Start=number_slider, Step=number_slider_2, Count=number_slider_3)
sin = Sine(Value=series)
multiplication = Multiplication(A=sin, B=Slider(100, range=0..100))
linear_regression = Hops(
    X=series_2,
    Y=multiplication,
    CacheResultsInMemory=False,
    CacheSolveResults=False,
    RemoteDefinitionLocation="http://127.0.0.1:5000/linear_regression",
    RemoteSolveVersion=(0, 1, 0),
    ShowInput_Enabled=False,
    ShowInput_Path=False,
    SynchronousSolve=True)
panel_4 = Panel(linear_regression)
pt = ConstructPoint(XCoordinate=series_2, YCoordinate=series, ZCoordinate=0)
file = ReadFile(File="C:\Users\bawic\Desktop\OpenAI\Key\KeyMichaelWickerson.txt", PerLineParse=True)
send = BooleanToggle(True)
panel_5 = Panel(file)
intcrv = Interpolate(Vertices=pt, Degree=3, Periodic=False, KnotStyle=1)  # -> Curve, Length, Domain
chatgpt = GhPythonScript(api_key=file, request=panel_3, send=send)  # -> answer; inputs send: Boolean
# ---------- chatgpt: Python ----------
__author__ = "peter"
__version__ = "2023.01.18"

#calling peters api key on local files, to do: add in more json promts that link to api calls. could be good for uv map generations. 

import rhinoscriptsyntax as rs
import urllib2
import json


url = "https://api.openai.com/v1/completions"


data = json.dumps({ "model": "text-davinci-003", "prompt": request, "temperature": 0.5,  "max_tokens": 1024})
headers = { "Content-Type": "application/json", "Authorization": "Bearer {0}".format(api_key) }

answer = "Send to request to Open AI"

if send:

    req = urllib2.Request(url, data, headers)
    response = urllib2.urlopen(req)


    response_text = response.read()
    response_json = json.loads(response_text)


    answer = response_json["choices"][0]["text"]

print(answer)
# ---------- end chatgpt ----------
pi = Pi(Factor=1)
here = CSharpScript()  # -> out, here
# ---------- here: C# usings ----------
using System.IO;
# ---------- here: C# ----------
    string currentFolder = "";

    GH_Document doc = owner.OnPingDocument();
    string filePath = doc.FilePath;
    string pathOnly = Path.GetDirectoryName(filePath);

    here = pathOnly;
# ---------- end here ----------

script_parasite = ScriptParasite(Enable=Toggle(False), Folder=here.here)
createpython_001 = CSharpScript()  # -> out, A, B, C; disabled
# ---------- createpython_001: C# ----------
    //Write the c# script for the following psuedo code for the c# node in grasshopper for Rhino3d
    //create a script that generates a point grid that creates a curve that looks like a womans profile

    //create point grid
    //create a list of points
    Point3d[] pts = new Point3d[10];
    //create a list of points using Math.random
    Random rnd = new Random();
    for (int i = 0; i < pts.Length; i++)
    {
      pts[i] = new Point3d(rnd.Next(0, 10), rnd.Next(0, 10), rnd.Next(0, 10));
    }
    //create a curve from the points
    Curve crv = Curve.CreateInterpolatedCurve(pts, 3);
    //output the curve
    A = crv;
# ---------- end createpython_001 ----------

panel_6 = Panel(here.here)
panel_7 = Panel(chatgpt)
curve = Curve(createpython_001.C)  # disabled
curve_2 = Curve(createpython_001.A)  # disabled
mesh_pipe = MeshPipe(Polylines=<missing>, NumberOfSides=4, Tolerance=0.1, Radius=1, Cap=False, Join=False)

# ----
# Oscillation Engine
trigger_2 = Trigger(Interval=20, TimerInterval=20, Target=data_recorder_2)  # disabled
data_recorder_2 = DataRecorder("1", DataLimit=10000, RecordData=False)
list_length_2 = ListLength(List=data_recorder_2)
panel_8 = Panel(list_length_2)
pi_2 = Pi(Factor=1)
division = Division(A=panel_8, B=Slider(71, range=1..220))
cosine = Cosine(Value=division)
sine = Sine(Value=division)
multiplication_2 = Multiplication(A=cosine, B=pi_2)
absolute = Absolute(Value=multiplication_2)
panel_9 = Panel([cosine, sine])

multiplication_3 = Multiplication(A=cosine, B=pi_2)

absolute_2 = Absolute(Value=multiplication_3)
addition = Addition(A=absolute, B=absolute_2)

multiplication_4 = Multiplication(A=Slider(100, range=-100..100), B=cosine)
series_3 = Series(Start=multiplication_4, Step=number_slider_3, Count=number_slider_3)
pt_2 = ConstructPoint(XCoordinate=series_3, YCoordinate=linear_regression, ZCoordinate=0)
ln = Line(StartPoint=pt, EndPoint=pt_2)
intcrv_2 = Interpolate(Vertices=pt_2, Degree=3, Periodic=False, KnotStyle=1)  # -> Curve, Length, Domain
mp = MultiPipe(Curves=ln, NodeSize=pi, EndOffset=1, StrutSize=1, Segment=0, KinkAngle=0.6, CubeFit=0, Caps="-")
