# Grasshopper definition LinearRegression_002.gh (Grasshopper 1.0.7)
# plug-ins: ScriptParasite, Fologram For Grasshopper Utilities, Bifocals, Hops

# ----
# Bake Engine
trigger = Trigger(Interval=1000, TimerInterval=1000, Target=data_recorder)  # disabled
data_recorder = DataRecorder("1", DataLimit=-10, RecordData=False)
list_length = ListLength(List=data_recorder)
testnumbereven = TestNumberEven(num=list_length)  # -> out, IsEven; inputs num: Int32
# ---------- testnumbereven: C# ----------
    int mod = num % 2;
    IsEven = (mod == 0 ? true : false);
# ---------- end testnumbereven ----------
panel = Panel(list_length)
panel_2 = Panel(testnumbereven.IsEven)

panel_3 = Panel("""#Write the python 3.0 script for the following psuedo code for the hops node in grasshopper for Rhino3d
#use flask and the ghhops_server in python 3.0 and the @hops.component
#create a machine learning algorithm for linear regression
#inputs are test data, inputs, outputs, seed and outputs are results""")
ground_size = Slider(20, range=0..20)  # disabled
radius = Slider(1, range=0..1)  # disabled
sample_size = Slider(30, range=0..100)  # disabled
seed = Slider(8, range=0..10)  # disabled
read_file = ReadFile(File="C:\Users\bawic\Desktop\OpenAI\Key\KeyMichaelWickerson.txt", PerLineParse=True)
rectangle = Rectangle(Plane=PlaneXY(0, 0, 0), XSize=ground_size, YSize=ground_size, Radius=0)  # -> Rectangle, Length; disabled
send = BooleanToggle(True)
panel_4 = Panel(read_file)
chatgpt = GhPythonScript(api_key=read_file, request=panel_3, send=send)  # -> answer; inputs send: Boolean
# ---------- chatgpt: Python ----------
__author__ = "peter"
__version__ = "2023.01.18"

#calling peters api key on local files, to do: add in more json promts that link to api calls. could be good for uv map generations. 

import rhinoscriptsyntax as rs
import urllib2
import json


url = "https://api.openai.com/v1/completions"


data = json.dumps({ "model": "text-davinci-003", "prompt": request, "temperature": 0.5,  "max_tokens": 1024})
headers = { "Content-Type": "application/json", "Authorization": "Bearer {0}".format(api_key) }

answer = "Send to request to Open AI"

if send:

    req = urllib2.Request(url, data, headers)
    response = urllib2.urlopen(req)


    response_text = response.read()
    response_json = json.loads(response_text)


    answer = response_json["choices"][0]["text"]

print(answer)
# ---------- end chatgpt ----------
populate_2d = Populate2D(Region=rectangle.Rectangle, Count=sample_size, Seed=1)  # disabled
populate_2d_2 = Populate2D(Region=rectangle.Rectangle, Count=sample_size, Seed=seed)  # disabled
triangles = Slider(3, range=0..10)  # disabled
squares = Slider(4, range=0..10)  # disabled
panel_5 = Panel(chatgpt)
polygon = Polygon(Plane=populate_2d, Radius=radius, Segments=triangles, FilletRadius=0)  # -> Polygon, Length; disabled
polygon_2 = Polygon(Plane=populate_2d_2, Radius=radius, Segments=squares, FilletRadius=0)  # -> Polygon, Length; disabled
line = Line(StartPoint=populate_2d, EndPoint=populate_2d_2)  # disabled
line_2 = Line(StartPoint=populate_2d, EndPoint=populate_2d_2)  # disabled
applestocks_lr = Hops(
    X=Slider(2, range=0..10),
    Y=Slider(8, range=0..10),
    Z=Slider(10, range=0..10),
    CacheResultsInMemory=True,
    CacheSolveResults=True,
    RemoteDefinitionLocation="http://127.0.0.1:5000/appleStocks_LR",
    RemoteSolveVersion=(0, 1, 0),
    ShowInput_Enabled=False,
    ShowInput_Path=False,
    SynchronousSolve=True)
deconstruct = Deconstruct(Point=populate_2d_2)  # -> XComponent, YComponent, ZComponent; disabled
deconstruct_2 = Deconstruct(Point=populate_2d)  # -> XComponent, YComponent, ZComponent; disabled
panel_6 = Panel(applestocks_lr)
linear_regression = Hops(
    X=deconstruct_2.XComponent,
    Y=deconstruct.YComponent,
    CacheResultsInMemory=False,
    CacheSolveResults=False,
    RemoteDefinitionLocation="http://127.0.0.1:5000/linear_regression",
    RemoteSolveVersion=(0, 1, 0),
    ShowInput_Enabled=False,
    ShowInput_Path=False,
    SynchronousSolve=True)  # disabled
panel_7 = Panel(linear_regression)  # disabled
construct_point = ConstructPoint(XCoordinate=deconstruct_2.XComponent, YCoordinate=linear_regression, ZCoordinate=0)  # disabled
circle = Circle(Plane=construct_point, Radius=radius)  # disabled
interpolate = Interpolate(Vertices=construct_point, Degree=3, Periodic=False, KnotStyle=1)  # -> Curve, Length, Domain; disabled
boundary_surfaces = BoundarySurfaces(Edges=circle)  # disabled
here = CSharpScript()  # -> out, here
# ---------- here: C# usings ----------
using System.IO;
# ---------- here: C# ----------
    string currentFolder = "";

    GH_Document doc = owner.OnPingDocument();
    string filePath = doc.FilePath;
    string pathOnly = Path.GetDirectoryName(filePath);

    here = pathOnly;
# ---------- end here ----------

script_parasite = ScriptParasite(Enable=Toggle(False), Folder=here.here)
createpython_001 = CSharpScript()  # -> out, A, B, C; disabled
# ---------- createpython_001: C# ----------
    //Write the c# script for the following psuedo code for the c# node in grasshopper for Rhino3d
    //create a script that generates a point grid that creates a curve that looks like a womans profile

    //create point grid
    //create a list of points
    Point3d[] pts = new Point3d[10];
    //create a list of points using Math.random
    Random rnd = new Random();
    for (int i = 0; i < pts.Length; i++)
    {
      pts[i] = new Point3d(rnd.Next(0, 10), rnd.Next(0, 10), rnd.Next(0, 10));
    }
    //create a curve from the points
    Curve crv = Curve.CreateInterpolatedCurve(pts, 3);
    //output the curve
    A = crv;
# ---------- end createpython_001 ----------

panel_8 = Panel(here.here)
curve = Curve(createpython_001.C)  # disabled
curve_2 = Curve(createpython_001.A)  # disabled
mesh_pipe = MeshPipe(Polylines=<missing>, NumberOfSides=4, Tolerance=0.1, Radius=1, Cap=False, Join=False)

# ----
# Oscillation Engine
trigger_2 = Trigger(Interval=20, TimerInterval=20, Target=data_recorder_2)  # disabled
data_recorder_2 = DataRecorder("1", DataLimit=10000, RecordData=False)
list_length_2 = ListLength(List=data_recorder_2)
panel_9 = Panel(list_length_2)
pi = Pi(Factor=1)
division = Division(A=panel_9, B=Slider(71, range=1..220))
cosine = Cosine(Value=division)
sine = Sine(Value=division)
multiplication = Multiplication(A=cosine, B=pi)
absolute = Absolute(Value=multiplication)
panel_10 = Panel([cosine, sine])

multiplication_2 = Multiplication(A=cosine, B=pi)

absolute_2 = Absolute(Value=multiplication_2)
addition = Addition(A=absolute, B=absolute_2)
